# Grasshopper definition script to share simple.gh (Grasshopper 0.9.76)
# plug-ins: Python Interpreter

panel = Panel("This file allows generating highly parametric louvres in front of a window. The louvres ca be individually tilted and have specific properties suc as size, thickness, reflectance")

# ---- group: Parameters for optimization
number_of_louvers = Slider(10, range=10..22)
# Angle of the louvres connected to a list
angles_of_the_louvres = GenePool(
    Decimals=0,
    Maximum=3,
    Minimum=0,
    Value=[0.02848552355, 2.069428717, 0.1261218824, 0.5062738361, 2.251115452, 2.460987632, 2.202175067, 1.718869504, 0.5460969049, 2.646562514, 1.010487956, 1.603980217, 1.520853631, 1.062104193, 1.260483604, 2.119767343, 2.718138307, 1.495938097, 0.6802364367, 0.4520050769, 0.5772425777, 0.6625543747])
# Width of the louvres
louvre_width_in_m = GenePool(
    Decimals=2,
    Maximum=0.2,
    Minimum=0.1,
    Value=[0.1057744356, 0.1984656635, 0.1739188417, 0.1837251801, 0.1562534033, 0.1704861101, 0.1092808492, 0.1946498051, 0.1931703591, 0.1975925005, 0.1864522605, 0.1766590001, 0.114736987, 0.1553307289, 0.1949577323, 0.1323080553, 0.1637420544, 0.1331896008, 0.1628642768, 0.1194968236, 0.153232432, 0.1773407718])
# Louvre allowed interval size
defines_the_size_of_the_interval_for_eac = GenePool(
    Decimals=0,
    Maximum=100,
    Minimum=1,
    Value=[87.00663087, 44.24134713, 20.05429998, 26.26244686, 71.4197131, 81.89376909, 52.3106701, 34.206959, 97.60293359, 14.07711146, 30.46708162, 23.22079638, 35.88561804, 76.07399112, 88.39774027, 35.77747653, 81.21589901, 28.97109684, 73.55135819, 72.20507527, 7.715440343, 93.01088861])  # "Defines the size of the interval for each blade"
# Louvre position in each interval
defines_where_in_the_interval_the_louvre = GenePool(
    Decimals=2,
    Maximum=1,
    Minimum=0,
    Value=[0.3304451634, 0.9573923699, 0.2976525149, 0.3764390038, 0.9944825343, 0.948570115, 0.6418389062, 0.4637173825, 0.3229082645, 0.6923766165, 0.4512911602, 0.4437683792, 0.04045512629, 0.3001794297, 0.0966744246, 0.2521551468, 0.03064584348, 0.9096646953, 0.4560665352, 0.8130716744, 0.7529409793, 0.06464301147])  # "Defines where in the interval the louvre is (calculated as the relative percentage of the size)"
defines_the_louvre_blade_material_1_pv_0 = GenePool(Decimals=0, Maximum=1, Minimum=0, Value=[1, 0, 0, 1, 1, 1, 0, 1, 1, 1, 1, 1, 0, 1, 1, 0, 1, 1, 0, 0, 0, 1])  # "Defines the louvre blade material (1= PV, 0= aluminium)"
height_of_the_louvres = GenePool(
    Decimals=2,
    Maximum=0.05,
    Minimum=0.01,
    Value=[0.02459606722, 0.03251058274, 0.02599018783, 0.01103701483, 0.02633403703, 0.0139837597, 0.02591804291, 0.03058982485, 0.02702478716, 0.03567249063, 0.02868191447, 0.01748738841, 0.03797501059, 0.04914916254, 0.03017003834, 0.0113739855, 0.02662547434, 0.0475058239, 0.04780287454, 0.02400141734, 0.0242271737, 0.04281171028])

# ----
offset_from_wall = Slider(0.1, range=0.07..0.2)
wall_thickness_outwards = Slider(-0.16, range=-1..1)
# EPW
# BUILDING GEOMETRY
location_epw_file = Panel("C:\DAYSIM\wea\NOR_Oslo.Fornebu.014880_IWEC.epw")
# I. INPUT PARAMETERS
honeybee = Honeybee_Honeybee()  # -> Vviiiiiiiiiizzz; plug-in component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
ladybug = Ladybug_Ladybug()  # -> Vviiiiiiiiiizzz; plug-in component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
box = DomainBox(Base=PlaneXY(0, 0, 0), X=Slider(4, range=0..10), Y=Slider(4, range=0..10), Z=Slider(2.5, range=0..10))
exporthydra = Hydra_ExportFile(fileName="Parametric_louvres", fileDescription=panel, export=Toggle(False))  # -> readMe; inputs fileDescription: list, changeLog: list, fileTags: list, includeRhino: Boolean, GHForThumb: Boolean, additionalImgs: list, export: Boolean
# ---------- exporthydra: Python ----------
# Hydra: A Plugin for example file sharing
# 
# This file is part of Hydra.


"""
Use this component to export your GH file to your Hydra repository so that you can upload and share with the community!
-
Provided by Hydra 0.0.02

    Args:
        _fileName: A text name for your example file.
        _fileDescription: A text description of your example file.  This can be a list and each item will be written as a new paragraph.
        changeLog_: A text description of the changes that you have made to the file if this is a new version of an old example file.
        fileTags_: An optional list of test tags to decribe your example file.  This will help others search for your file easily.
        targetFolder_: Input a file path here to the hydra folder on you machine if you are not using the default Github structure that places your hydra github repo in your documents folder.
        includeRhino_: Set to 'True' to include the Rhino file in the zip file that gets uploaded to your hydra fork.  This is important if you are referencing Rhino geometry and have not internalized it in the GH document.  By default, this is set to 'False', which will only include the grasshopper file.
        GHForThumb_: Set to 'True' to have the thumbnail of your example file be of your GH canvas.  By default, the thumbnail will be of the Rhino scene since this is where the cool geometric output of the file displays.  If your file is not producing a geometric output, you will want to set this to 'True.'
        additionalImgs_: A list of file paths to additional images that you want to be shown in Hydra page 
        _export: Set to "True" to export the Grasshopper file to Hydra.
    Returns:
        readMe!: ...
"""

ghenv.Component.Name = "Hydra_ExportFile"
ghenv.Component.NickName = 'exportHydra'
ghenv.Component.Message = 'VER 0.0.02\nNOV_18_2015'
ghenv.Component.Category = "Extra"
ghenv.Component.SubCategory = "Hydra"
try: ghenv.Component.AdditionalHelpFromDocStrings = "1"
except: pass

import Grasshopper.Kernel as gh
import scriptcontext as sc
import shutil
import os
import zipfile
import Grasshopper.GUI as ghGUI
import System
import Grasshopper.Instances as ghInst
import time
from time import mktime
from datetime import datetime
import json
import Rhino as rc


def checkTheInputs():
    # Set a warning variable.
    w = gh.GH_RuntimeMessageLevel.Warning
    c = gh.GH_RuntimeMessageLevel.Remark
    
    #Replace any spaces in the connected fileName with underscores.
    fileName = _fileName.strip().replace(" ","_")
    
    #Set a default directory to the Github default if none has been input.
    checkData1 = True
    repoTargetFolder = None
    fullForkTarget = None
    if targetFolder_:
        if not os.path.isdir(targetFolder_):
            checkData1 = False
            warning = "The connected directory to targetFolder_ does not exist on your machine."
            print warning
            ghenv.Component.AddRuntimeMessage(w, warning)
        else:
            if targetFolder_.endswith('\\'):
                repoTargetFolder = targetFolder_ + fileName
                fullForkTarget = targetFolder_
            else:
                repoTargetFolder = targetFolder_ + '\\' + fileName
                fullForkTarget = targetFolder_ + '\\'
    else:
        hydraFolder = None
        username = os.getenv("USERNAME")
        githubDirectory = "C:\\Users\\" + username + "\\Documents\\GitHub\\"
        for file in os.listdir(githubDirectory):
            if 'hydra' in file: hydraFolder = githubDirectory + file + "\\"
        if hydraFolder == None: hydraFolder = "C:\\Users\\" + username + "\\Documents\\GitHub\\hydra\\"
        if not os.path.isdir(hydraFolder):
            checkData1 = False
            warning = "The component cannot automatically find the hydra repo on your machine. \n Plug in the correct file path of the hydra repo to the targetFolder_ input on this component."
            print warning
            ghenv.Component.AddRuntimeMessage(w, warning)
        else:
            repoTargetFolder = hydraFolder + fileName
            fullForkTarget = hydraFolder
    
    
    # Check the directory and create it if it does not exist.  If it does exist, it is, there is not an old version of this example file and I should make a new directory.
    gitUserTrigger = False
    gitUserName = None
    forkName = None
    checkData2 = True
    if repoTargetFolder != None:
        
        #Pull out the username from the config file.
        configFile = fullForkTarget + '.git\\config'
        if os.path.isfile(configFile):
            with open(configFile, "r") as cnfFile:
                for lineCount, line in enumerate(cnfFile):
                    if '[remote "origin"]' in line: gitUserTrigger = True
                    elif gitUserTrigger == True and 'https://github.com/' in line:
                        gitUserName = line.split('https://github.com/')[-1].split('/')[0]
                        forkName = line.split('/')[-1].split('.git')[0]
                        gitUserTrigger = False
        else:
            checkData2 = False
            warning = "Could not find the config file in your Hydra fork on your system. \n Make sure that you have cloned hydra to your system. \n If you have cloned hydra, plug in the correct file path of the hydra repo to the targetFolder_ input on this component."
            print warning
            ghenv.Component.AddRuntimeMessage(w, warning)
    
    #Make a list of file tags that includes the example file name if nothing else is connected.
    if len(fileTags_) == 0:
        fileTags = []
        for word in _fileName.split(' '):
            fileTags.append(word)
    elif len(fileTags_) == 1 and ',' in fileTags_[0]:
        fileTags = fileTags_[0].split(',')
    elif len(fileTags_) == 1 and ';' in fileTags_[0]:
        fileTags = fileTags_[0].split(';')
    elif len(fileTags_) == 1:
        fileTags = fileTags_[0].split('\n')
    else:
        fileTags = fileTags_
    
    if not 'Grasshopper' in fileTags and \
       not 'grasshopper' in fileTags:
        fileTags.append('Grasshopper')
    
    fileTags = [tag.strip() for tag in fileTags]
    
    #Check to be sure that the user has saved this currently open GH file so that we can copy it.
    checkData3 = True
    document = ghenv.Component.OnPingDocument()
    doucumentPath = document.FilePath
    if doucumentPath!=None and os.path.isfile(doucumentPath): pass
    else:
        checkData3 = False
        warning = "You have not yet saved this Grasshopper file to your machine. \n You must save it first in order to export it to Hydra."
        print warning
        ghenv.Component.AddRuntimeMessage(w, warning)
    
    #Check to be sure that the user has saved this currently open Rhino file so that we can copy it.
    checkData4 = True
    rhinoDocPath = rc.RhinoDoc.ActiveDoc.Path
    if os.path.isfile(rhinoDocPath): pass
    elif not os.path.isfile(rhinoDocPath) and includeRhino_ == True:
        checkData4 = False
        warning = "You must save your Rhino file in order to export it to Hydra. \nEither save your file or set 'includeRhino_' to 'False'."
        print warning
        ghenv.Component.AddRuntimeMessage(w, warning)
    else:
        comment = "You have not yet saved this Rhino file to your machine. \nYou will be able to use the 'includeRhino_' input to this component to include the rhino file with your example."
        print comment
        ghenv.Component.AddRuntimeMessage(c, comment)
    
    #Give a final check for everything.
    if checkData1 == True and checkData2 == True and checkData3 == True and checkData4 == True: checkData = True
    else: checkData = False
    
    
    return checkData, fileName, _fileDescription, fileTags, repoTargetFolder, doucumentPath, document, rhinoDocPath, gitUserName, forkName


def writeGHRhino(fileName, repoTargetFolder, doucumentPath, rhinoDocPath):
    #Write out a list for the source files.
    zipFileDirectory = repoTargetFolder + '\\' + fileName
    if not os.path.isdir(zipFileDirectory): os.mkdir(zipFileDirectory)
    
    #Write out a GH file to the folder.
    ghFilePath = zipFileDirectory + '\\' + fileName + '.gh'
    shutil.copyfile(doucumentPath, ghFilePath)
    
    #If the user has requested writing the Rhino file, write it there.
    rhinoWritten = False
    rhioDestinationPath = zipFileDirectory + '\\' + fileName + '.3dm'
    if includeRhino_:
        if rhinoDocPath != '':
            shutil.copyfile(rhinoDocPath, rhioDestinationPath)
            rhinoWritten = True
    else:
        rhioDestinationPath = zipFileDirectory + '\\' + fileName + '.3dm'
        if os.path.isfile(rhioDestinationPath):
            os.remove(rhioDestinationPath)
    
    #Zip the files together.
    zipFilePath = repoTargetFolder + '\\' + fileName
    
    zf = zipfile.ZipFile("%s.zip" % (zipFilePath), "w", zipfile.ZIP_DEFLATED)
    abs_src = os.path.abspath(zipFileDirectory)
    for dirname, subdirs, files in os.walk(zipFileDirectory):
        for filename in files:
            absname = os.path.abspath(os.path.join(dirname, filename))
            arcname = absname[len(abs_src) + 1:]
            zf.write(absname, arcname)
    zf.close()
    
    #Delete the old zip directory.
    shutil.rmtree(zipFileDirectory)
    
    return zipFilePath


def writeReadMe(fileName, fileDescription, repoTargetFolder, changeLog, gitUserName, fileTags, forkName):
    readMeFilePath = repoTargetFolder + '\\' + 'README.md'
    
    #Write the description.
    readMeFile = open(readMeFilePath, "w")
    readMeFile.write('### Description \n')
    for line in fileDescription:
        readMeFile.write(line + '\n')
    readMeFile.write('\n')
    
    #Write in a link to the user's page and to the hydra page.
    readMeFile.write('This file has been submitted by [' + gitUserName + '](https://github.com/' + gitUserName + ')')
    readMeFile.write('\n')
    readMeFile.write('\n')
    readMeFile.write('[Check out this example on Hydra!](http://hydrashare.github.io/hydra/viewer?owner=' + gitUserName + '&fork=' + forkName + '&id=' + fileName + ')')
    readMeFile.write('\n')
    
    # Write change log in the file
    if len(changeLog) != 0:
        for line in changeLog:
            readMeFile.write(line + '\n')
    
    #Write in the file tags.
    readMeFile.write('### Tags \n')
    for linecount, line in enumerate(fileTags):
        if linecount+1 != len(fileTags): readMeFile.write(line + ', ')
        else: readMeFile.write(line)
    readMeFile.write('\n')
    
    #Write in a link to the thumbnail.
    readMeFile.write('### Thumbnail \n')
    readMeFile.write("![Screenshot](https://raw.githubusercontent.com/" + gitUserName + "/hydra/master/" + fileName + "/thumbnail.png)")
    readMeFile.write('\n')
    
    readMeFile.close()
    
    return readMeFilePath



def getAllTheComponents(document, onlyGHPython = False):
    components = []
    
    for component in document.Objects:
        if onlyGHPython and type(component)!= type(ghenv.Component): pass
        else: components.append(component)
    
    return components


def getMetaData(ghComps, fileTags, fileName, rhinoDocPath, additionalImgs):
    #Create the dictionary.
    metaDataDict = {}
    
    #Get the names of all of the components on the canvas and add them to the dictionary.
    metaDataDict["components"] = {}
    metaDataDict["images"] = []
    metaDataDict["videos"] = {}
    metaDataDict["dependencies"] = []
    
    grasshopperNative = ['Params', 'Maths', 'Sets', 'Vector', 'Curve', 'Surface', 'Mesh', 'Intersect', 'Transform', 'Display', 'Hydra']
    notImportantComps = ['Hydra', 'Scribble', 'Hydra_ExportFile', 'Hydra_ImportFile', 'Group', 'Panel', 'Slider', 'Boolean Toggle', 'Custom Preview', 'Colour Swatch','Button', 'Control Knob', 'Digit Scroller', 'MD Slider', 'Value List', 'Point', 'Vector', 'Circle', 'Circular Arc', 'Curve', 'Line', 'Plane', 'Rectangle', 'Box', 'Mesh', 'Mesh Face', 'Surface', 'Twisted Box', 'Field', 'Geometry', 'Geometry Cache', 'Geometry Pipeline', 'Transform']
    
    for component in ghComps:
        componentName = component.Name
        if componentName in notImportantComps: pass
        elif metaDataDict["components"].has_key(componentName):
            metaDataDict["components"][componentName] += 1
        else:
            metaDataDict["components"][componentName] = 1
        
        # find dependencies
        componentCategory = component.Category
        if componentCategory == "Extra" or componentCategory == "User":
                componentCategory = component.SubCategory
                
        if componentCategory not in grasshopperNative + metaDataDict["dependencies"]:
            metaDataDict["dependencies"].append(componentCategory)
            
    #Put in tags.
    metaDataDict['tags'] = fileTags
    
    # Put in the path to the gh scene image.
    metaDataDict["images"].append({fileName + '_GH.png' : "Grasshopper Definition"})
    
    # Put in the path to the rhino scene image.
    if not GHForThumb_:
        metaDataDict["images"].append({fileName + '_Rhino.png' : "Rhino Viewport Screenshot"})
    
    # add additional images to image list; at some point we should expose adding description for each image
    for img in additionalImgs:
        if os.path.isfile(img):
            metaDataDict["images"].append({os.path.split(img)[1] : "Additional Image"})
    
    # Put in the path to the thumbnail file.
    metaDataDict['thumbnail'] = 'thumbnail.png'
    
    # Put in the path to the zip file.
    metaDataDict['file'] = fileName + '.zip'
    
    
    return metaDataDict


def writeMetadataFile(fileName, repoTargetFolder, metaDataDict):
    jsonFilePath = repoTargetFolder + '\\' + 'input.json'
    with open(jsonFilePath, "w") as outfile:
        json.dump(metaDataDict, outfile)
    
    return jsonFilePath


def writeGHImage(fileName, repoTargetFolder):
    #Set the final File Path.
    filePathName = repoTargetFolder + '\\' + fileName + '_GH.png'
    
    #Take a tiled image using the GH Method.
    imageSettings = ghGUI.Canvas.GH_Canvas.GH_ImageSettings()
    canvas = ghInst.ActiveCanvas
    rect = gh.GH_Convert.ToRectangle(canvas.Document.BoundingBox(False))
    
    #System.Drawing.Rectangle 
    imgsOfCanvas = ghGUI.Canvas.GH_Canvas.GenerateHiResImage(canvas, rect, imageSettings)
    
    #This part is adapted and translated from David Rutten's VB script:
    # http://www.grasshopper3d.com/forum/topics/access-to-grasshopper-image-stitcher-ghis
    #Long live David!!!!
    
    #Prepare a large image to absorb the smaller images.
    tileWidth = 1000
    tileHeight = 1000
    width = int(str(imgsOfCanvas[-1]).split(',')[0].split('=')[-1])
    height = int(str(imgsOfCanvas[-1]).split(',')[-1].split('=')[-1].split('}')[0])
    smallImages = imgsOfCanvas[0]
    
    #If the image is too large, rezie it.
    if width > 16000 : width = 16000
    if height > 16000: height = 16000
    
    #Build the big image.
    fullImage = System.Drawing.Bitmap(width, height, System.Drawing.Imaging.PixelFormat.Format24bppRgb)
    fullFrame = System.Drawing.Rectangle(0, 0, tileWidth, tileHeight)
    fullGraphics = System.Drawing.Graphics.FromImage(fullImage)
    fullGraphics.InterpolationMode = System.Drawing.Drawing2D.InterpolationMode.NearestNeighbor
    fullGraphics.Clear(System.Drawing.Color.White)
    
    #Re-order the list of images to be correct
    newSmallImgDict = {}
    for image in smallImages:
        imageEnd = str(image).split('\\')[-1].split('.png')[0]
        imageHoriz = imageEnd.split(';')[0]
        imageVert = imageEnd.split(';')[-1]
        if not newSmallImgDict.has_key(imageHoriz) and int(imageHoriz) <= 15 and int(imageVert) <= 15: newSmallImgDict[imageHoriz] = [image]
        elif int(imageHoriz) <= 15 and int(imageVert) <= 15: newSmallImgDict[imageHoriz].append(image)
    
    #Join the smaller images into the larger images.
    fullFrame.Y = 0
    for columnNum in range(len(newSmallImgDict)):
        for rowNum in range(len(newSmallImgDict['0'])):
            #Select out the correct image.
            image = newSmallImgDict[str(columnNum)][rowNum]
            
            #Adjust the frame.
            #We need to move it right by tileWidth pixel
            #If the frame goes past the right, move it to the top of the next column.
            if fullFrame.Y >= height:
                fullFrame.Y = 0
                fullFrame.X += tileWidth
            
            #Now load the target image from the disk...
            targetImage = System.Drawing.Bitmap(image)
            
            #...and paint it into the target frame
            fullGraphics.DrawImage(targetImage, fullFrame)
            
            #Delete the targetImage from memory.
            targetImage.Dispose()
            
            fullFrame.Y += tileHeight
    
    
    #Save the image and dispose of it from memory.
    fullImage.Save(filePathName)
    fullGraphics.Dispose()
    
    return filePathName, fullImage, width, height


def writeRhinoImage(fileName, repoTargetFolder):
    viewtoCapture = sc.doc.Views.ActiveView  
    dispMode = viewtoCapture.ActiveViewport.DisplayMode
    image_h = viewtoCapture.ActiveViewport.Size.Height
    image_w = viewtoCapture.ActiveViewport.Size.Width
    viewSize = System.Drawing.Size(int(image_w), int(image_h))
    pic = rc.Display.RhinoView.CaptureToBitmap(viewtoCapture , viewSize)
    
    fullPath = repoTargetFolder + '\\' + fileName + '_Rhino.png'
    System.Drawing.Bitmap.Save(pic , fullPath)
    
    return fullPath, pic, image_w, image_h

def copyAddiationalImages(additionalImgs, repoTargetFolder):
    
    for img in additionalImgs:
        #chek if the file already exist
        if os.path.isfile(img):
            # copy to the file to the folder
            try:
                shutil.copyfile(img, repoTargetFolder + '\\' + os.path.split(img)[1])
            except:
               msg = "Failed to copy " + img
               print msg

def makeThumbnailImg(ghImgFile, rhinoImgFile, gw, gh, rw, rh, repoTargetFolder):
    #Set universal variables.
    thumbnailPath = repoTargetFolder + '\\' + 'thumbnail.png'
    thumbnailW = 200
    
    if GHForThumb_:
        #Calculate what the height should be.
        imgRatio = gh/gw
        thumbnailH = thumbnailW*imgRatio
        imgSize = System.Drawing.Size(thumbnailW, thumbnailH)
        imgHeight = ghImgFile.Height
        #Get the thumbnail image and save it
        fullImage = System.Drawing.Bitmap(ghImgFile,imgSize)
        System.Drawing.Bitmap.Save(fullImage , thumbnailPath)
    else:
        #Calculate what the height should be.
        imgRatio = rh/rw
        thumbnailH = thumbnailW*imgRatio
        imgSize = System.Drawing.Size(thumbnailW, thumbnailH)
        #Get the thumbnail image and save it
        fullImage = System.Drawing.Bitmap(rhinoImgFile,imgSize)
        System.Drawing.Bitmap.Save(fullImage , thumbnailPath)
    
    
    return thumbnailPath, fullImage


def main(fileName, fileDescription, fileTags, repoTargetFolder, doucumentPath, \
        document, rhinoDocPath, gitUserName, forkName, additionalImgs):
    #Write the GH file into a GHX file.
    ghFile = writeGHRhino(fileName, repoTargetFolder, doucumentPath, rhinoDocPath)
    
    #Take a high-res image of the grasshopper canvass.
    ghImgFile, ghImg, gw, gh = writeGHImage(fileName, repoTargetFolder)
    
    #Take an image of the Rhino scene
    if not GHForThumb_:
        rhinoImgFile, rhImg, rw, rh = writeRhinoImage(fileName, repoTargetFolder)
    else:
        rhImg, rw, rh = "", 1, 1
        
    #Make a thumbnail image.
    thumbnailImgFile, thumbnailImg = makeThumbnailImg(ghImg, rhImg, gw, gh, rw, rh, repoTargetFolder)
    
    #Clear the images from the computer memory.
    ghImg.Dispose()
    if not GHForThumb_:
        rhImg.Dispose()
    thumbnailImg.Dispose()    
    
    #Copy additional images to folder if any
    copyAddiationalImages(additionalImgs, repoTargetFolder)
    
    #Write the readMe into a text file.
    descriptFile = writeReadMe(fileName, fileDescription, repoTargetFolder, changeLog_, gitUserName, fileTags, forkName)
    
    #Get all of the components on the canvass and pull out their information so that they can be written into a metadata file.
    ghComps = getAllTheComponents(document)
    metaDataDict = getMetaData(ghComps, fileTags, fileName, rhinoDocPath, additionalImgs)
    metadataFile = writeMetadataFile(fileName, repoTargetFolder, metaDataDict)



if _export:
    if _fileName and len(_fileDescription) != 0:
        checkData, fileName, fileDescription, fileTags, repoTargetFolder, \
            doucumentPath, document, rhinoDocPath, gitUserName, forkName = checkTheInputs()
        
        if checkData == True:
            main(fileName, fileDescription, fileTags, repoTargetFolder, \
                doucumentPath, document, rhinoDocPath, gitUserName, \
                forkName, additionalImgs_)
    else:
        msg = "One of the mandatory inputs is missing!"
        print msg
        ghenv.Component.AddRuntimeMessage(gh.GH_RuntimeMessageLevel.Warning, msg)
# ---------- end exporthydra ----------
glzparamlist = Honeybee_GlazingParametersList(northGlzParam=0, westGlzParam=0, southGlzParam=Slider(0.6, range=0..1), eastGlzParam=0)  # -> glzParamList; plug-in component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
mass2zone = Honeybee_Masses2Zones(zoneMasses=flatten(box), zoneNames="office", maxRoofAngle=30, createHBZones=Toggle(True))  # -> readMe, HBZones; plug-in component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
multiplication = Multiplication(A=offset_from_wall, B="-1")
Y = UnitY(Factor=wall_thickness_outwards)
glazingcreator = Honeybee_GlazingBasedOnRatio(HBObjects=mass2zone.HBZones, glzRatio=glzparamlist, breakUpWindow=Toggle(False), runIt=Toggle(True))  # -> readMe, HBObjWGLZ; plug-in component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
brep = Brep(glazingcreator.HBObjWGLZ)
panel_2 = Panel(glazingcreator.readMe)
panel_3 = Panel("Louvre material type")
# 9. LOUVER BLADES DEFINITION
panel_4 = Panel("Louvre thickness")

# ----
# ENVELOPE COMPONENTS
decomposebytype = Honeybee_DecomposeBasedOnType(HBZone=brep)  # -> walls, interiorWalls, airWalls, windows, interiorWindows, skylights, roofs, ceilings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; plug-in component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
preview = CustomPreview(
    Geometry=[decomposebytype.walls, decomposebytype.groundFloors, decomposebytype.roofs],
    Shader=ColourSwatch(SwatchColor=RGB(247, 159, 0)))
preview_2 = CustomPreview(Geometry=decomposebytype.windows, Shader=ColourSwatch(SwatchColor=RGB(137, 221, 232)))
brep_2 = Brep(decomposebytype.walls)

# ----
# This retrives the vertices of the window to know where to start the louvred shading system
debrep = DeconstructBrep(Brep=decomposebytype.windows)  # -> Faces, Edges, Vertices
panel_5 = Panel(debrep.Vertices)
item = ListItem(List=panel_5, Index="1", Wrap=True)
item_2 = ListItem(List=panel_5, Index="0", Wrap=True)
item_3 = ListItem(List=panel_5, Index="2", Wrap=True)
bang = ExplodeTree(Data=graft(item_3))  # -> _000000, Branch1
bang_2 = ExplodeTree(Data=graft(item))  # -> _000000, Branch1
bang_3 = ExplodeTree(Data=graft(item_2))  # -> _000000, Branch1
pdecon = Deconstruct(Point=bang_3._000000)  # -> XComponent, YComponent, ZComponent
pdecon_2 = Deconstruct(Point=bang._000000)  # -> XComponent, YComponent, ZComponent
pdecon_3 = Deconstruct(Point=bang_2._000000)  # -> XComponent, YComponent, ZComponent
subtraction = Subtraction(A=pdecon_2.XComponent, B=pdecon.XComponent)
subtraction_2 = Subtraction(A=pdecon_3.ZComponent, B=pdecon.ZComponent)

# ---- group: Removes the indices of the louvres not used
removes_excess_data_from_list = SplitList(List=height_of_the_louvres, Index=number_of_louvers)  # -> ListA, ListB
split = SplitList(List=angles_of_the_louvres, Index=number_of_louvers)  # -> ListA, ListB
split_2 = SplitList(List=defines_the_size_of_the_interval_for_eac, Index=number_of_louvers)  # -> ListA, ListB
split_3 = SplitList(List=defines_the_louvre_blade_material_1_pv_0, Index=number_of_louvers)  # -> ListA, ListB
split_4 = SplitList(List=defines_where_in_the_interval_the_louvre, Index=number_of_louvers)  # -> ListA, ListB
removes_excess_data_from_list_2 = SplitList(List=louvre_width_in_m, Index=number_of_louvers)  # -> ListA, ListB

# ----
# Extrudes the south wall to account for wall thickness in the daylithing simulation
extr = Extrude(Base=brep_2, Direction=Y)

# ---- group: Creates the starting points for each individual louvre
addition = Addition(A=pdecon.ZComponent, B=subtraction_2)
pt = ConstructPoint(XCoordinate=pdecon.XComponent, YCoordinate=multiplication, ZCoordinate=pdecon.ZComponent)
pt_2 = ConstructPoint(XCoordinate=pdecon.XComponent, YCoordinate=multiplication, ZCoordinate=addition)
ln = Line(StartPoint=pt, EndPoint=pt_2)
subtraction_3 = Subtraction(A=number_of_louvers, B="1")
divide = DivideCurve(Curve=ln, Count=subtraction_3, Kinks=False)  # -> Points, Tangents, Parameters
pdecon_4 = Deconstruct(Point=divide.Points)  # -> XComponent, YComponent, ZComponent

# ----
area = Area(Geometry=decomposebytype.groundFloors)  # -> Area, Centroid

# ----
# 1. DAYLIGHT SIM
pcen = PolygonCenter(Polyline=decomposebytype.groundFloors)  # -> CenterV, CenterE, CenterA
Z = UnitZ(Factor="0.8")
move = Move(Geometry=pcen.CenterA, Motion=Z)  # -> Geometry, Transform
lighting_4w_m2 = Panel("9.6")
auto_dimming_with_switchoff_occupancy_se = Panel("4")  # "Auto Dimming with SwitchOff occupancy sensor"
minimum_electric_dimming_in = Panel("20")
minimum_illuminance_in_lux = Slider(500, range=200..800)
multiplication_2 = Multiplication(A=lighting_4w_m2, B=area.Area)
lightingcontrol = Honeybee_LightingControlRecipe(
    controlType=auto_dimming_with_switchoff_occupancy_se,
    sensorPoints=move.Geometry,
    lightingPower=multiplication_2,
    lightingSetpoint=minimum_illuminance_in_lux,
    ballastLossFactor=minimum_electric_dimming_in,
    standbyPower="0",
    delayTime="0")  # -> lightingControlGroup; plug-in component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

area_2 = Area(Geometry=decomposebytype.groundFloors)  # -> Area, Centroid

# ---- group: DAYSIM occupancy generator
hour_1 = Slider(6, range=1..24)
hour_2 = Slider(17, range=1..24)
day = Slider(1, range=1..31)
day_2 = Slider(31, range=1..31)
analysisperiod = Ladybug_AnalysisPeriod(
    fromMonth=Slider(1, range=1..12),
    fromDay=day,
    fromHour=hour_1,
    toMonth=Slider(12, range=1..12),
    toDay=day_2,
    toHour=hour_2)  # -> readMe, analysisPeriod; plug-in component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
occupancygenerator = Honeybee_DaysimOccupancyGenerator(
    occupancyPeriod=analysisperiod.analysisPeriod,
    dailyOffHours="-1",
    weekendDays="1,2",
    fileName="OfficeOccupancyRadiance",
    writeTheOcc=Toggle(True))  # -> occupancyFile; plug-in component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
panel_6 = Panel(occupancygenerator)

# ----
# Calculates the size of the intervals of space where each louvre can be without colliding with the surrounding blades.
panel_7 = Panel("2")
integer_division = IntegerDivision(A=number_of_louvers, B=panel_7)
multiplication_3 = Multiplication(A=integer_division, B=panel_7)
series = Series(Start="0", Step=1, Count=multiplication_3)
series_2 = Series(Start="1", Step=1, Count=multiplication_3)
division = Division(A=louvre_width_in_m, B="2")
subtraction_4 = Subtraction(A=number_of_louvers, B="1")
split_5 = SplitList(List=division, Index=subtraction_4)  # -> ListA, ListB
minimum_additional_safety_distance = Panel("0.10")
size_of_intervals_from_octopus = Panel(split_2.ListA)
ma = MassAddition(Input=size_of_intervals_from_octopus)  # -> Result, PartialResults
division_2 = Division(A=size_of_intervals_from_octopus, B=ma.Result)

# ---- group: Updates the z coordinate of the starting point of the louvres to match optimisation parameters
series_3 = Series(Start="0", Step=1, Count=number_of_louvers)

# ---- group: Louvres are created as diamond shapes
multiplication_4 = Multiplication(A=removes_excess_data_from_list.ListA, B="0.5")
multiplication_5 = Multiplication(A=removes_excess_data_from_list.ListA, B="-0.5")
louvre_widths = Number(removes_excess_data_from_list_2.ListA)
Z_2 = UnitZ(Factor=multiplication_4)
Z_3 = UnitZ(Factor=multiplication_5)
multiplication_6 = Multiplication(A=louvre_widths, B="-1")
multiplication_7 = Multiplication(A="-0.5", B=louvre_widths)
Y_2 = UnitY(Factor=multiplication_6)
Y_3 = UnitY(Factor=multiplication_7)

# ---- group: Louvres are first drawn by their center line
X = UnitX(Factor=1)

# ---- group: Rotation control of each louvre surface
louver_angles_list = Panel("""0
-15
-30
-45""")
item_4 = ListItem(List=louver_angles_list, Index=split.ListA, Wrap=True)
rad = Radians(Degrees=item_4)

# ----
item_5 = ListItem(List=item_4, Index=series, Wrap=True)
item_6 = ListItem(List=item_4, Index=series_2, Wrap=True)
partition = PartitionList(List=item_5, Size="2")
partition_2 = PartitionList(List=item_6, Size="2")
sort = SortList(Keys=partition_2)  # -> Keys, ValuesA
sort_2 = SortList(Keys=partition)  # -> Keys, ValuesA
item_7 = ListItem(List=sort_2.Keys, Index="1", Wrap=True)  # -> flatten(Item)
item_8 = ListItem(List=sort.Keys, Index="1", Wrap=True)  # -> flatten(Item)
weave = Weave(Pattern=[0, 1], Stream0=item_7, Stream1=item_8, NullGaps=False)
rad_2 = Radians(Degrees=weave)
sin = Sine(Value=rad_2)
multiplication_8 = Multiplication(A=sin, B=split_5.ListA)
addition_2 = Addition(A=multiplication_8, B=minimum_additional_safety_distance)
ins = InsertItems(List=addition_2, Item="0", Indices="0", Wrap=True)
no_louvre_interval_size = Panel(ins)
ma_2 = MassAddition(Input=ins)  # -> Result, PartialResults
subtraction_5 = Subtraction(A=subtraction_2, B=ma_2.Result)
multiplication_9 = Multiplication(A=division_2, B=subtraction_5)
size_of_the_intervals_with_louvres = Panel(multiplication_9)
weave_2 = Weave(Pattern=[0, 1], Stream0=graft(ins), Stream1=graft(multiplication_9), NullGaps=False)  # -> flatten(Weave)
ma_3 = MassAddition(Input=weave_2)  # -> Result, flatten(PartialResults)
addition_3 = Addition(A=ma_3.PartialResults, B=pdecon.ZComponent)
partition_3 = PartitionList(List=addition_3, Size="2")
split_6 = SplitList(List=partition_3, Index="1")  # -> flatten(ListA), flatten(ListB)
replaces_the_start_with_the_bottom_of_th = ReplaceItems(List=split_6.ListA, Item=pdecon.ZComponent, Indices="0", Wrap=False)  # "Replaces the start with the bottom of the window"
subtraction_6 = Subtraction(A=split_6.ListB, B=split_6.ListA)
multiplication_10 = Multiplication(A=subtraction_6, B=split_4.ListA)
addition_4 = Addition(A=multiplication_10, B=replaces_the_start_with_the_bottom_of_th)
final_z_coordinate_list = Panel(addition_4)

# ---- group: Updates the z coordinate of the starting point of the louvres to match optimisation parameters (continued)
item_9 = ListItem(List=final_z_coordinate_list, Index=series_3, Wrap=True)
replace = ReplaceItems(List=pdecon_4.ZComponent, Item=item_9, Indices="0", Wrap=Toggle(True))  # -> flatten(List)
pt_3 = ConstructPoint(XCoordinate=pdecon_4.XComponent, YCoordinate=pdecon_4.YComponent, ZCoordinate=replace)

# ---- group: Louvres are first drawn by their center line (continued)
line = LineSDL(Start=pt_3, Direction=X, Length=subtraction)
line_2 = Line(line)

# ---- group: Louvres are created as diamond shapes (continued)
pt_4 = Point(pt_3)
move_2 = Move(Geometry=pt_4, Motion=Y_3)  # -> Geometry, Transform
move_3 = Move(Geometry=move_2.Geometry, Motion=Z_2)  # -> Geometry, Transform
move_4 = Move(Geometry=move_2.Geometry, Motion=Z_3)  # -> Geometry, Transform
move_5 = Move(Geometry=pt_4, Motion=Y_2)  # -> Geometry, Transform
pt_5 = Point(move_5.Geometry)
srf4pt = _4PointSurface(CornerA=move_3.Geometry, CornerB=pt_5, CornerC=move_4.Geometry, CornerD=pt_4)
geo = Geometry(srf4pt)

# ---- group: Rotation control of each louvre surface (continued)
rotax = RotateAxis(Geometry=geo, Angle=rad, Axis=line_2)  # -> Geometry, Transform

# ---- group: If true (PV blade) then goes into geometry list A, if false (normal louver blade) goes into geometry list B / Top part of the blade that will have PV or not
top_of_the_louvres_with_material_to_deci = Brep(rotax.Geometry)  # "Top of the louvres with material to decide"

# ---- group: If true (PV blade) then goes into geometry list A, if false (normal louver blade) goes into geometry list B
# Changes the material type of the surface of the louvres
int = Integer(split_3.ListA)
if_x_1_pv_else_0 = Expression(x=int, Expression="If(x=1, True,False)")  # -> flatten(Assigns_TRUE_if_1_and_False_if_0)
X_2 = UnitX(Factor=subtraction)
extr_2 = Extrude(Base=top_of_the_louvres_with_material_to_deci, Direction=X_2)
dispatch = Dispatch(List=extr_2, DispatchPattern=flatten(if_x_1_pv_else_0))  # -> ListA, ListB
louvres_type_1 = Panel(dispatch.ListA)
louvres_type_0 = Panel(dispatch.ListB)
brep_regular_blades = Brep(dispatch.ListB)
aluminium_material = CustomPreview(Geometry=brep_regular_blades, Shader=ColourSwatch(SwatchColor=RGB(124, 94, 255)))

# ----
brep_3 = Brep(dispatch.ListA)

move_6 = Move(Geometry=brep_regular_blades, Motion=Y)  # -> Geometry, Transform
# Accounts for wall thickness by moving louvres for the daylighting system
move_7 = Move(Geometry=brep_3, Motion=Y)  # -> Geometry, Transform

# ---- group: If true (PV blade) then goes into geometry list A, if false (normal louver blade) goes into geometry list B (continued)
pv_material = CustomPreview(Geometry=brep_3, Shader=ColourSwatch(SwatchColor=RGB(255, 46, 182)))

# ----
# Here you connect the different elements of context for which you want to change the reflectance of
kontext_3 = Geometry(flatten([<brep referenced from the Rhino model> x2]))
kontext_1 = Geometry(flatten(brep_3))
kontext_2 = Geometry(flatten(brep_regular_blades))
kontext_4 = Geometry(flatten([<brep referenced from the Rhino model> x2]))
glazed_reflectance_context_2 = Slider(0.65, range=0..1)
opaque_reflectance_context_1 = Slider(0.1, range=0..1)
opaque_reflectance_context_3 = Slider(0.2, range=0..1)
opaque_reflectance_context_4 = Slider(0.65, range=0..1)
fractionwwr_context_1 = Slider(0, range=0..0.95)
fractionwwr_context_2 = Slider(0, range=0..0.95)
fractionwwr_context_3 = Slider(0, range=0..0.95)
fractionwwr_context_4 = Slider(0, range=0..0.95)
glazed_reflectance_context_1 = Slider(0.1, range=0..1)
glazed_reflectance_context_3 = Slider(0.2, range=0..1)
glazed_reflectance_context_4 = Slider(0.65, range=0..1)
context_1 = Panel("Louvres_type_0")
context_2 = Panel("Louvres_type_1")
context_4 = Panel("")
opaque_reflectance_context_2 = Slider(0.65, range=0..1)
context_3 = Panel("")
lng = ListLength(List=kontext_1)
lng_2 = ListLength(List=kontext_2)
lng_3 = ListLength(List=kontext_3)
lng_4 = ListLength(List=kontext_4)
mergematerial = Merge(
    Data1=opaque_reflectance_context_1,
    Data2=opaque_reflectance_context_2,
    Data3=opaque_reflectance_context_3,
    Data4=opaque_reflectance_context_4)
merge = Merge(Data1=fractionwwr_context_1, Data2=fractionwwr_context_2, Data3=fractionwwr_context_3, Data4=fractionwwr_context_4)
mergename = Merge(Data1=context_1, Data2=context_2, Data3=context_3, Data4=context_4)
mergematerial_2 = Merge(
    Data1=glazed_reflectance_context_1,
    Data2=glazed_reflectance_context_2,
    Data3=glazed_reflectance_context_3,
    Data4=glazed_reflectance_context_4)
mergelistlenght = Merge(Data1=lng, Data2=lng_2, Data3=lng_3, Data4=lng_4)
mergevolume = Merge(Data1=kontext_1, Data2=kontext_2, Data3=kontext_3, Data4=kontext_4)

# ----
# MODIFICATION OF THE REFLECTANCE OF THE SHADING SURFACES FOR E+
# Connect this as HB CONTEXT
partition_4 = PartitionList(List=mergevolume, Size=mergelistlenght)
debrep_2 = DeconstructBrep(Brep=partition_4)  # -> Faces, Edges, Vertices
lng_5 = ListLength(List=debrep_2.Faces)
flatten = FlattenTree(Tree=lng_5, Path="{0}")
partition_5 = PartitionList(List=flatten, Size=mergelistlenght)
ma_4 = MassAddition(Input=partition_5)  # -> Result, PartialResults
flatten_2 = FlattenTree(Tree=ma_4.Result, Path="{0}")
_0 = Number(0)
series_4 = Series(Start=merge, Step=_0, Count=flatten_2)
series_5 = Series(Start=mergematerial_2, Step=_0, Count=flatten_2)
series_6 = Series(Start=mergematerial, Step=_0, Count=flatten_2)
flatten_3 = FlattenTree(Tree=series_5, Path="{0}")
flatten_4 = FlattenTree(Tree=series_6, Path="{0}")
flatten_5 = FlattenTree(Tree=series_4, Path="{0}")

# ----
# This group is the "key", the "holy graal" of the energy simulation
this_is_default_construction_in_honeybee = Panel("TEK17Window")  # "This is default construction in Honeybee. If you're using a different construction make sure to add it to additionalStrings"
hb_epcontextsrf = HoneybeeEPContextSurfaces(shdSurfaces=flatten(mergevolume))  # -> HBContext; inputs shdSurfaces: list of Brep, justBoundingBox: Boolean
# ---------- hb_epcontextsrf: Python ----------
"""
prepare shading/context geometries

    Args:
        northVectorOrRotation: A vector that shows North or a number that shows
                               the rotation of the North from the Y axis
        bldgMasses: List of closed Breps as thermal zones.
    Returns:
        report: ...
        thermalZones: Thermal zone's geometries for visualiza
"""

ghenv.Component.Name = 'Honeybee EP context Surfaces'
ghenv.Component.NickName = 'HB_EPContextSrf'
ghenv.Component.Message = 'VER 0.0.63\nJAN_20_2018'
ghenv.Component.IconDisplayMode = ghenv.Component.IconDisplayMode.application
ghenv.Component.Category = "Honeybee"
ghenv.Component.SubCategory = "10 | Energy | Energy"
#compatibleHBVersion = VER 0.0.57\nNOV_04_2016
#compatibleLBVersion = VER 0.0.59\nFEB_01_2015
ghenv.Component.AdditionalHelpFromDocStrings = "2"

import rhinoscriptsyntax as rs
import Rhino as rc
import scriptcontext as sc
import os
import System
import Grasshopper.Kernel as gh
import uuid

tolerance = sc.doc.ModelAbsoluteTolerance
import math


def main(shdSurfaces, EPTransSchedule, meshingSettings, justBoundingBox):
    
    # import the classes
    if sc.sticky.has_key('honeybee_release'):

        try:
            if not sc.sticky['honeybee_release'].isCompatible(ghenv.Component): return -1
            if sc.sticky['honeybee_release'].isInputMissing(ghenv.Component): return -1
        except:
            warning = "You need a newer version of Honeybee to use this compoent." + \
            " Use updateHoneybee component to update userObjects.\n" + \
            "If you have already updated userObjects drag Honeybee_Honeybee component " + \
            "into canvas and try again."
            w = gh.GH_RuntimeMessageLevel.Warning
            ghenv.Component.AddRuntimeMessage(w, warning)
            return -1
        
        # don't customize this part
        hb_EPSrf = sc.sticky["honeybee_EPSurface"]
        hb_EPSHDSurface = sc.sticky["honeybee_EPShdSurface"]
        hb_RADMaterialAUX = sc.sticky["honeybee_RADMaterialAUX"]
        hb_EPObjectsAux = sc.sticky["honeybee_EPObjectsAUX"]()
        HBScheduleList = sc.sticky["honeybee_ScheduleLib"].keys()

        ########################################################################
        #----------------------------------------------------------------------#
        shdBreps = []
        # create bounding box of shading geometries
        if justBoundingBox:
            for brep in shdSurfaces:
                if brep.Faces.Count>1 or not brep.Faces[0].IsPlanar(sc.doc.ModelAbsoluteTolerance):
                    shdBreps.append(brep.GetBoundingBox(True).ToBrep())
                else:
                    shdBreps.append(brep)
        else:
            shdBreps = shdSurfaces
        
        shadingClasses = []
        shadingMeshPreview = []
        
        if meshingSettings == None:
            mp = rc.Geometry.MeshingParameters.Minimal
            mp.SimplePlanes = True
        else:
            mp = meshingSettings
        
        def getRadMaterialName(radMaterial):
            nameStr = radMaterial.split(" ")[2]
            name =  nameStr.split("\n")[0]
            return name
        
        for brepCount, brep in enumerate(shdBreps):
            if brep != None:
                isPlanar = True
                # check planarity
                for face in brep.Faces:
                    if not face.IsPlanar(tolerance):
                        isPlanar = False
                        break
                
                shadingBreps = []
                if not isPlanar:
                    meshArray = rc.Geometry.Mesh.CreateFromBrep(brep, mp)
                    for mesh in meshArray:
                        for meshFace in range(mesh.Faces.Count):
                            vertices = list(mesh.Faces.GetFaceVertices(meshFace))[1:]
                            vertices = vertices + [sc.doc.ModelAbsoluteTolerance]
                            # create the brep from mesh
                            shdBrep = rc.Geometry.Brep.CreateFromCornerPoints(*vertices)
                            shadingBreps.append(shdBrep)
                else:
                    for face in brep.Faces:
                        shadingBreps.append(face.DuplicateFace(False))
                
                for faceCount, shdBrep in enumerate(shadingBreps):
                        thisShading = hb_EPSHDSurface(shdBrep, 1000*brepCount + faceCount, 'shdSrf_' + `brepCount` + '_' + `faceCount` + "_" + str(uuid.uuid4()))
                        
                        # add transmittance schedule if any
                        if EPTransSchedule!=None:
                            schedule= EPTransSchedule.upper()
                            if schedule!=None and not schedule.lower().endswith(".csv") and schedule not in HBScheduleList:
                                msg = "Cannot find " + schedule + " in Honeybee schedule library."
                                print msg
                                ghenv.Component.AddRuntimeMessage(gh.GH_RuntimeMessageLevel.Warning, msg)
                                return -1
                            elif schedule!=None and schedule.lower().endswith(".csv"):
                                # check if csv file is existed
                                if not os.path.isfile(schedule):
                                    msg = "Cannot find the shchedule file: " + schedule
                                    print msg
                                    ghenv.Component.AddRuntimeMessage(gh.GH_RuntimeMessageLevel.Warning, msg)
                                    return -1
                            
                            thisShading.TransmittanceSCH = schedule
                        
                        # add the Rad Material if any
                        if RADMaterial!=None:
                            # if it is just the name of the material make sure it is already defined
                            if len(RADMaterial.split(" ")) == 1:
                                # if the material is not in the library add it to the library
                                if not hb_RADMaterialAUX.isMatrialExistInLibrary(RADMaterial):
                                    warningMsg = "Can't find " + RADMaterial + " in RAD Material Library.\n" + \
                                                "Add the material to the library and try again."
                                    ghenv.Component.AddRuntimeMessage(gh.GH_RuntimeMessageLevel.Warning, warningMsg)
                                    return
                                
                                try:
                                    thisShading.setRADMaterial(RADMaterial)
                                except Exception, e:
                                    print e
                                    warningMsg = "You are using an old version of Honeybee_Honeybee! Update your files and try again."
                                    print warningMsg
                                    ghenv.Component.AddRuntimeMessage(gh.GH_RuntimeMessageLevel.Warning, warningMsg)
                                    return
                                
                                addedToLib = True
                            else:
                                
                                # try to add the material to the library
                                addedToLib, thisShading.RadMaterial = hb_RADMaterialAUX.analyseRadMaterials(RADMaterial, True)
                                
                            if addedToLib==False:
                                warningMsg = "Failed to add " + RADMaterial + " to the Library."
                                ghenv.Component.AddRuntimeMessage(gh.GH_RuntimeMessageLevel.Warning, warningMsg)
                                return
                        
                        # add shading to the list
                        shadingClasses.append(thisShading)
                
        # add to the hive
        hb_hive = sc.sticky["honeybee_Hive"]()
        HBContext  = hb_hive.addToHoneybeeHive(shadingClasses, ghenv.Component)
        return HBContext
        ################################################################################################
    else:
        print "You should first let Honeybee to fly..."
        w = gh.GH_RuntimeMessageLevel.Warning
        ghenv.Component.AddRuntimeMessage(w, "You should first let Honeybee to fly...")
        return -1
        

if _shdSurfaces and _shdSurfaces[0]!=None:
    # add cleaning function
    result= main(_shdSurfaces, EPTransSchedule_, meshingSettings_, justBoundingBox_)
    
    if result != -1: HBContext = result
# ---------- end hb_epcontextsrf ----------
getsethbobjname = Honeybee_GetOrSetHBObjectName(HBObjects=hb_epcontextsrf)  # -> HBObjects, names; plug-in component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
python = PythonScript(
    names=getsethbobjname.names,
    unglazedRef=flatten_3,
    glazedRef=flatten_4,
    WWR=flatten_5,
    glazingConstr=this_is_default_construction_in_honeybee)  # -> out, ref; inputs names: list, unglazedRef: list, glazedRef: list, WWR: list
# ---------- python: Python ----------
def createEPRef(name, unglazedRef, glazedRef, WWR, glazingConstr):
    return "ShadingProperty:Reflectance,\n" \
        "{}, !- Name of Surface:Shading Object\n" \
        "{},  !- Diffuse Solar Reflectance of Unglazed Part of Shading Surface\n" \
        "{},  !- Diffuse Visible Reflectance of Unglazed Part of Shading Surface\n" \
        "{},  !- Fraction of Shading Surface That Is Glazed\n" \
        "{}; !- Name of Glazing Construction\n".format(
        name + "_0", unglazedRef, glazedRef, WWR, glazingConstr
        )

if (len(names) == len(unglazedRef) and len(unglazedRef) == len(glazedRef)and len(glazedRef) == len(WWR)) == True:
    refList = []
    for i in range(len(names)):
        reflectances = createEPRef(names[i], unglazedRef[i], glazedRef[i], WWR[i], glazingConstr)
        refList.append(reflectances)
    ref = "\n".join(refList)
else:
    print "The length of the lists do not match"
# ---------- end python ----------
connect_this_to_additional_strings = Panel(python.ref)

# ----
# Honeybee radiance materials &
# geometry allocation
number_slider = Slider(0.169, range=0..1)
number_slider_2 = Slider(0.65, range=0..1)
number_slider_3 = Slider(0.2, range=0..1)
pt_6 = ConstructPoint(XCoordinate=0, YCoordinate=0, ZCoordinate=0)
radmetalmaterial = Honeybee_RadianceMetalMaterial(
    materialName="Louvre type 1",
    RReflectance=number_slider_2,
    GReflectance=number_slider_2,
    BReflectance=number_slider_2,
    roughness=0,
    specularity=0.9)  # -> RADMaterial; plug-in component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
radmetalmaterial_2 = Honeybee_RadianceMetalMaterial(
    materialName="Louvre type 0",
    RReflectance=number_slider,
    GReflectance=number_slider,
    BReflectance=number_slider,
    roughness=0,
    specularity=0.9)  # -> RADMaterial; plug-in component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
radopaquematerial = Honeybee_RadianceOpaqueMaterial(
    materialName="Ground_20",
    RReflectance=number_slider_3,
    GReflectance=number_slider_3,
    BReflectance=number_slider_3,
    roughness=0.05,
    specularity=0)  # -> avrgRef, RADMaterial; plug-in component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
toggle = BooleanToggle(True)
addtolibrary = Honeybee_AddToRadianceLibrary(
    RADMaterial=[radmetalmaterial, radopaquematerial.RADMaterial],
    addToProjectLib=toggle,
    overwrite=toggle,
    addToHoneybeeLib=toggle)  # -> readMe; plug-in component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
south_wall_with_thickness = Brep(extr)
setradmaterials = Honeybee_SetRadianceMaterials(
    HBObject=brep,
    wallRADMaterial="Interior_Wall",
    windowRADMaterial="TEK17Window",
    windowRADMaterial_2="TEK17Window2",
    roofRADMaterial="Interior_Ceiling",
    floorRADMaterial="Interior_Floor",
    ceilingRADMaterial="Interior_Ceiling")  # -> modifiedHBObject; plug-in component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
hb_epcontextsrf_2 = HoneybeeEPContextSurfaces(shdSurfaces=flatten(move_6.Geometry), RADMaterial=radmetalmaterial_2)  # -> flatten(HBContext); inputs shdSurfaces: list of Brep, justBoundingBox: Boolean
# ---------- hb_epcontextsrf_2: Python ----------
"""
prepare shading/context geometries

    Args:
        northVectorOrRotation: A vector that shows North or a number that shows
                               the rotation of the North from the Y axis
        bldgMasses: List of closed Breps as thermal zones.
    Returns:
        report: ...
        thermalZones: Thermal zone's geometries for visualiza
"""

ghenv.Component.Name = 'Honeybee EP context Surfaces'
ghenv.Component.NickName = 'HB_EPContextSrf'
ghenv.Component.Message = 'VER 0.0.62\nJUL_28_2017'
ghenv.Component.IconDisplayMode = ghenv.Component.IconDisplayMode.application
ghenv.Component.Category = "Honeybee"
ghenv.Component.SubCategory = "10 | Energy | Energy"
#compatibleHBVersion = VER 0.0.57\nNOV_04_2016
#compatibleLBVersion = VER 0.0.59\nFEB_01_2015
ghenv.Component.AdditionalHelpFromDocStrings = "2"

import rhinoscriptsyntax as rs
import Rhino as rc
import scriptcontext as sc
import os
import System
import Grasshopper.Kernel as gh
import uuid

tolerance = sc.doc.ModelAbsoluteTolerance
import math


def main(shdSurfaces, EPTransSchedule, meshingSettings, justBoundingBox):
    
    # import the classes
    if sc.sticky.has_key('honeybee_release'):

        try:
            if not sc.sticky['honeybee_release'].isCompatible(ghenv.Component): return -1
            if sc.sticky['honeybee_release'].isInputMissing(ghenv.Component): return -1
        except:
            warning = "You need a newer version of Honeybee to use this compoent." + \
            " Use updateHoneybee component to update userObjects.\n" + \
            "If you have already updated userObjects drag Honeybee_Honeybee component " + \
            "into canvas and try again."
            w = gh.GH_RuntimeMessageLevel.Warning
            ghenv.Component.AddRuntimeMessage(w, warning)
            return -1
        
        # don't customize this part
        hb_EPSrf = sc.sticky["honeybee_EPSurface"]
        hb_EPSHDSurface = sc.sticky["honeybee_EPShdSurface"]
        hb_RADMaterialAUX = sc.sticky["honeybee_RADMaterialAUX"]
        hb_EPObjectsAux = sc.sticky["honeybee_EPObjectsAUX"]()
        HBScheduleList = sc.sticky["honeybee_ScheduleLib"].keys()

        ########################################################################
        #----------------------------------------------------------------------#
        shdBreps = []
        # create bounding box of shading geometries
        if justBoundingBox:
            for brep in shdSurfaces:
                if brep.Faces.Count>1 or not brep.Faces[0].IsPlanar(sc.doc.ModelAbsoluteTolerance):
                    shdBreps.append(brep.GetBoundingBox(True).ToBrep())
                else:
                    shdBreps.append(brep)
        else:
            shdBreps = shdSurfaces
        
        shadingClasses = []
        shadingMeshPreview = []
        
        if meshingSettings == None:
            mp = rc.Geometry.MeshingParameters.Minimal
            mp.SimplePlanes = True
        else:
            mp = meshingSettings
        
        def getRadMaterialName(radMaterial):
            nameStr = radMaterial.split(" ")[2]
            name =  nameStr.split("\n")[0]
            return name
        
        for brepCount, brep in enumerate(shdBreps):
            if brep != None:
                isPlanar = True
                # check planarity
                for face in brep.Faces:
                    if not face.IsPlanar(tolerance):
                        isPlanar = False
                        break
                
                shadingBreps = []
                if not isPlanar:
                    meshArray = rc.Geometry.Mesh.CreateFromBrep(brep, mp)
                    for mesh in meshArray:
                        for meshFace in range(mesh.Faces.Count):
                            vertices = list(mesh.Faces.GetFaceVertices(meshFace))[1:]
                            vertices = vertices + [sc.doc.ModelAbsoluteTolerance]
                            # create the brep from mesh
                            shdBrep = rc.Geometry.Brep.CreateFromCornerPoints(*vertices)
                            shadingBreps.append(shdBrep)
                else:
                    for face in brep.Faces:
                        shadingBreps.append(face.DuplicateFace(False))
                
                for faceCount, shdBrep in enumerate(shadingBreps):
                        thisShading = hb_EPSHDSurface(shdBrep, 1000*brepCount + faceCount, 'shdSrf_' + `brepCount` + '_' + `faceCount` + "_" + str(uuid.uuid4()))
                        
                        # add transmittance schedule if any
                        if EPTransSchedule!=None:
                            schedule= EPTransSchedule.upper()
                            if schedule!=None and not schedule.lower().endswith(".csv") and schedule not in HBScheduleList:
                                msg = "Cannot find " + schedule + " in Honeybee schedule library."
                                print msg
                                ghenv.Component.AddRuntimeMessage(gh.GH_RuntimeMessageLevel.Warning, msg)
                                return -1
                            elif schedule!=None and schedule.lower().endswith(".csv"):
                                # check if csv file is existed
                                if not os.path.isfile(schedule):
                                    msg = "Cannot find the shchedule file: " + schedule
                                    print msg
                                    ghenv.Component.AddRuntimeMessage(gh.GH_RuntimeMessageLevel.Warning, msg)
                                    return -1
                            
                            thisShading.TransmittanceSCH = schedule
                        
                        # add the Rad Material if any
                        if RADMaterial!=None:
                            # if it is just the name of the material make sure it is already defined
                            if len(RADMaterial.split(" ")) == 1:
                                # if the material is not in the library add it to the library
                                if not hb_RADMaterialAUX.isMatrialExistInLibrary(RADMaterial):
                                    warningMsg = "Can't find " + RADMaterial + " in RAD Material Library.\n" + \
                                                "Add the material to the library and try again."
                                    ghenv.Component.AddRuntimeMessage(gh.GH_RuntimeMessageLevel.Warning, warningMsg)
                                    return
                                
                                try:
                                    thisShading.setRADMaterial(RADMaterial)
                                except Exception, e:
                                    print e
                                    warningMsg = "You are using an old version of Honeybee_Honeybee! Update your files and try again."
                                    print warningMsg
                                    ghenv.Component.AddRuntimeMessage(gh.GH_RuntimeMessageLevel.Warning, warningMsg)
                                    return
                                
                                addedToLib = True
                            else:
                                
                                # try to add the material to the library
                                addedToLib, thisShading.RadMaterial = hb_RADMaterialAUX.analyseRadMaterials(RADMaterial, True)
                                
                            if addedToLib==False:
                                warningMsg = "Failed to add " + RADMaterial + " to the Library."
                                ghenv.Component.AddRuntimeMessage(gh.GH_RuntimeMessageLevel.Warning, warningMsg)
                                return
                        
                        # add shading to the list
                        shadingClasses.append(thisShading)
                
        # add to the hive
        hb_hive = sc.sticky["honeybee_Hive"]()
        HBContext  = hb_hive.addToHoneybeeHive(shadingClasses, ghenv.Component)
        return HBContext
        ################################################################################################
    else:
        print "You should first let Honeybee to fly..."
        w = gh.GH_RuntimeMessageLevel.Warning
        ghenv.Component.AddRuntimeMessage(w, "You should first let Honeybee to fly...")
        return -1
        

if _shdSurfaces and _shdSurfaces[0]!=None:
    # add cleaning function
    result= main(_shdSurfaces, EPTransSchedule_, meshingSettings_, justBoundingBox_)
    
    if result != -1: HBContext = result
# ---------- end hb_epcontextsrf_2 ----------
hb_epcontextsrf_3 = HoneybeeEPContextSurfaces(shdSurfaces=flatten(move_7.Geometry), RADMaterial=radmetalmaterial)  # -> flatten(HBContext); inputs shdSurfaces: list of Brep, justBoundingBox: Boolean; same code as hb_epcontextsrf_2
hb_epcontextsrf_4 = HoneybeeEPContextSurfaces(shdSurfaces=flatten(south_wall_with_thickness), RADMaterial="Interior_Wall")  # -> flatten(HBContext); inputs shdSurfaces: list of Brep, justBoundingBox: Boolean; same code as hb_epcontextsrf_2

# ---- group: Ground geometry with 0.2 reflectance
# II. PERFORMANCE SIMULATION
number_slider_4 = Slider(20, range=-10..20)
number_slider_5 = Slider(-10, range=-10..10)
pt_7 = Point(pt_6)
Y_4 = UnitY(Factor=number_slider_5)
vec = VectorXYZ(XComponent=number_slider_4, YComponent=number_slider_5, ZComponent=0)  # -> Vector, Length
X_3 = UnitX(Factor=number_slider_4)
X_4 = UnitX(Factor=Slider(-7, range=-10..10))
move_8 = Move(Geometry=pt_7, Motion=vec.Vector)  # -> Geometry, Transform
move_9 = Move(Geometry=pt_7, Motion=X_3)  # -> Geometry, Transform
move_10 = Move(Geometry=pt_7, Motion=Y_4)  # -> Geometry, Transform
srf4pt_2 = _4PointSurface(CornerA=pt_7, CornerB=move_9.Geometry, CornerC=move_8.Geometry, CornerD=move_10.Geometry)
boundary = BoundarySurfaces(Edges=srf4pt_2)
move_11 = Move(Geometry=boundary, Motion=X_4)  # -> Geometry, Transform
createhbsrfs = Honeybee_createHBSrfs(geometry=move_11.Geometry, srfName="ground", RADMaterial=radopaquematerial.RADMaterial)  # -> readMe, simplify(HBSurface); plug-in component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

# ----
hb_epcontextsrf_5 = HoneybeeEPContextSurfaces(shdSurfaces=flatten(createhbsrfs.HBSurface), RADMaterial=radopaquematerial.RADMaterial)  # -> flatten(HBContext); inputs shdSurfaces: list of Brep, justBoundingBox: Boolean; same code as hb_epcontextsrf_2
geometry_of_the_room_with_the_shading_sy = Geometry([hb_epcontextsrf_5, setradmaterials, hb_epcontextsrf_3, hb_epcontextsrf_4, hb_epcontextsrf_2])  # "Geometry of the room with the shading system"

ambient_resolution = Slider(300, range=0..1000)
ambient_accuracy = Slider(0.1, range=0..0.1)
ambient_division = Slider(1000, range=500..1500)
ambient_sampling = Slider(100, range=0..100)
overall_quality = Slider(1, range=0..2)
ambient_bounces = Slider(3, range=0..10)
radparameters = Honeybee_RADParameters(
    quality=overall_quality,
    ab=ambient_bounces,
    ad=ambient_division,
    as=ambient_sampling,
    ar=ambient_resolution,
    aa=ambient_accuracy)  # -> readMe, radParameters; plug-in component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
genhbzonetestpts = Honeybee_GenerateZoneTestPoints(HBZone=brep, gridSize=Slider(1, range=0..1), distBaseSrf=Slider(0.8, range=0..1), moveTestMesh=Toggle(True))  # -> readMe, simplify(testPoints), simplify(ptsVectors), simplify(facesArea), simplify(mesh); plug-in component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
panel_8 = Panel(radparameters.readMe)
annualdaylightsimulation = Honeybee_AnnualDaylightSimulation(
    epwWeatherFile=location_epw_file,
    testPoints=genhbzonetestpts.testPoints,
    ptsVectors=genhbzonetestpts.ptsVectors,
    testMesh=genhbzonetestpts.mesh,
    radParameters=radparameters.radParameters)  # -> analysisRecipe; plug-in component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
toggle_2 = BooleanToggle(True)
rundaylightanalysis = Honeybee_RunDaylightSimulation(
    HBObjects=flatten(geometry_of_the_room_with_the_shading_sy),
    analysisRecipe=annualdaylightsimulation,
    writeRad=toggle_2,
    runRad=toggle_2,
    numOfCPUs=Slider(11, range=0..100),
    radFileName="RadianceHP_AnnDayl",
    overwriteResults=True)  # -> readMe, analysisType, resultsUnit, results, testPts, annual_analysis_files, radGeoFile, studyFolder, done; plug-in component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
panel_9 = Panel(rundaylightanalysis.readMe)
readannualresultsi = Honeybee_ReadAnnualResultI(
    illFilesAddress=rundaylightanalysis.annual_analysis_files,
    testPoints=simplify(rundaylightanalysis.testPts),
    occupancyFiles=occupancygenerator,
    DLAIllumThresholds=minimum_illuminance_in_lux,
    runIt=Toggle(True))  # -> DLA, UDLI_Less_100, UDLI_100_2000, UDLI_More_2000, CDA, sDA, annualProfiles, htmReport; plug-in component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
dselectricallightinguse = Honeybee_DaysimElectricalLightingUse(htmlReport=readannualresultsi.htmReport)  # -> electricLightingUse; plug-in component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
lng_6 = ListLength(List=rundaylightanalysis.testPts)
ma_5 = MassAddition(Input=readannualresultsi.CDA)  # -> Result, PartialResults
division_3 = Division(A=ma_5.Result, B=lng_6)
gradientlibrary = Ladybug_GradientLibrary(gradIndex=Slider(1, range=0..10))  # -> customColors; plug-in component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
legendpar = Ladybug_LegendParameters(
    lowBound=Slider(0, range=0..100),
    highBound=Slider(100, range=0..100),
    numSegments=Slider(6, range=0..10),
    customColors=flatten(gradientlibrary),
    font="Arial",
    fontSize=Slider(0.365, range=0..1),
    decimalPlaces=Slider(0, range=0..10),
    removeLessThan=Toggle(True))  # -> legendPar; plug-in component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
concat = Concatenate(FragmentB=rundaylightanalysis.analysisType)
dom = ConstructDomain(DomainStart=0, DomainEnd=Slider(0.3, range=0..5))
recolormesh = Ladybug_RecolorMesh(
    analysisResult=readannualresultsi.CDA,
    inputMesh=genhbzonetestpts.mesh,
    heightDomain=dom,
    legendPar=legendpar,
    analysisTitle=concat,
    legendTitle="%fraction",
    bakeIt="2")  # -> readMe, newMesh, newLegend, legendBasePt, meshColors, legendColors; plug-in component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

# ----
# 2. ENERGYPLUS SIMULATION RESULTS
panel_10 = Panel("TimestepFrequency")
shadowpar = Honeybee_ShadowPar(calculationMethod=panel_10)  # -> shadowPar; plug-in component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
toggle_3 = BooleanToggle(True)
toggle_4 = BooleanToggle(True)
epoutput = Honeybee_GenerateEPOutput(
    zoneEnergyUse=toggle_3,
    zoneGainsAndLosses=toggle_3,
    zoneComfortMetrics=toggle_3,
    zoneHVACParams=toggle_3,
    surfaceTempAnalysis="False",
    surfaceEnergyAnalysis=toggle_4,
    glazingSolarAnalysis=toggle_4,
    loadType="0")  # -> report, flatten(simulationOutputs); plug-in component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
energysimpar = Honeybee_EnergySimulationPar(timestep=6, shadowCalcPar=shadowpar, solarDistribution="4")  # -> energySimPar; plug-in component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
toggle_5 = BooleanToggle(True)
runenergysimulation = Honeybee_RunEnergySimulation(
    epwFile=location_epw_file,
    energySimPar=energysimpar,
    HBZones=flatten(brep),
    HBContext=flatten([hb_epcontextsrf, hb_epcontextsrf_4]),
    simulationOutputs=flatten(epoutput.simulationOutputs),
    additionalStrings=python.ref,
    writeIdf=toggle_5,
    runEnergyPlus=toggle_5,
    idfFileName="TestingForShading")  # -> readMe, idfFileAddress, resultFileAddress, eioFileAddress, rddFileAddress, htmlReport, studyFolder; plug-in component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
readepresult = Honeybee_ReadEPResult(resultFileAddress=runenergysimulation.resultFileAddress)  # -> totalThermalLoad, thermalLoadBalance, cooling, heating, electricLight, electricEquip, port, port_2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; plug-in component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
strnum = Ladybug_SeparateData(inputList=flatten(readepresult.heating))  # -> flatten(numbers), strings; plug-in component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
strnum_2 = Ladybug_SeparateData(inputList=flatten(readepresult.cooling))  # -> numbers, strings; plug-in component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
strnum_3 = Ladybug_SeparateData(inputList=flatten(readepresult.totalThermalLoad))  # -> numbers, strings; plug-in component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
strnum_4 = Ladybug_SeparateData(inputList=flatten(readepresult.electricLight))  # -> numbers, strings; plug-in component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
strnum_5 = Ladybug_SeparateData(inputList=flatten(readepresult.totalSolarGain))  # -> numbers, strings; plug-in component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
strnum_6 = Ladybug_SeparateData(inputList=flatten(readepresult.mechVentilationEnergy))  # -> numbers, strings; plug-in component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
strnum_7 = Ladybug_SeparateData(inputList=flatten(readepresult.operativeTemperature))  # -> numbers, strings; plug-in component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
panel_11 = Panel(strnum_7.numbers)
ma_6 = MassAddition(Input=strnum_3.numbers)  # -> Result, PartialResults
ma_7 = MassAddition(Input=strnum_6.numbers)  # -> Result, PartialResults
panel_12 = Panel(ma_6.Result)
cooling_cop = Panel("5")
heating_cop = Panel("3")
panel_13 = Panel(ma_7.Result)
division_4 = Division(A=strnum.numbers, B=heating_cop)
division_5 = Division(A=strnum_2.numbers, B=cooling_cop)
ma_8 = MassAddition(Input=strnum_5.numbers)  # -> Result, PartialResults
ma_9 = MassAddition(Input=strnum_4.numbers)  # -> flatten(Result), PartialResults
ma_10 = MassAddition(Input=division_4)  # -> Result, PartialResults
ma_11 = MassAddition(Input=division_5)  # -> Result, PartialResults
cooling_kwh_a = Panel(ma_11.Result)
heating_kwh_a = Panel(ma_10.Result)
electric_light_kwh_a = Panel(ma_9.Result)
solar_heat_gain_kwh_year = Panel(ma_8.Result)
lighting_power_from_daylight_analysis = Panel(dselectricallightinguse)
addition_5 = Addition(A=heating_kwh_a, B=cooling_kwh_a, D=electric_light_kwh_a)
division_6 = Division(A=cooling_kwh_a, B="48")
division_7 = Division(A=heating_kwh_a, B="48")
division_8 = Division(A=electric_light_kwh_a, B="48")
fp_electricity = Panel("1")
heating = Panel(division_7)
panel_14 = Panel(division_8)
cooling = Panel(division_6)
multiplication_11 = Multiplication(A=addition_5, B=fp_electricity)
eval = Evaluate(F="round(x,2)", x=multiplication_11)
primary_energy_demand = Panel(eval)

panel_15 = Panel(runenergysimulation.readMe)
division_9 = Division(A=primary_energy_demand, B=area_2.Area)

normalized_primary_energy_demand_kwh_m2a = Panel(division_9)

# ----
# Results
net_energy_demand_kwh_m2_year = Panel(normalized_primary_energy_demand_kwh_m2a)
cda = Panel(division_3)
